# Dynamo graph Example.dyn (Dynamo 1.3.1.1736)

code_block = CodeBlock { "Dordrecht"; "Lange Geldersekade"; "1"; }
getLocationdataNetherlands = Custom[GIStoBIM.GetLocationdataNetherlands](city=code_block.out0, streetname=code_block.out1, housenumber=code_block.out2)  # Gives locationdata based on an adress in the Netherlands
setSharedCoordinate = Custom[GIStoBIM.SetSharedCoordinate](X=getLocationdataNetherlands.RDcoordinate_X_meters, Y=getLocationdataNetherlands.RDcoordinate_Y_meters)  # Set shared coordinate/project basepoint
code_block_2 = CodeBlock { 200; }
createBoundingBox = Custom[GIStoBIM.CreateBoundingBox](coordinateX=getLocationdataNetherlands.RDcoordinate_X_meters, coordinateY=getLocationdataNetherlands.RDcoordinate_Y_meters, boxWidth=code_block_2, boxHeight=code_block_2)  # create boundingboxstring for webrequests based on coördinates and dimensions
geoservicesLibraryNetherlands = Custom[GIStoBIM.GeoservicesLibraryNetherlands](BoundingBox=createBoundingBox)  # Library with multiple webadresses which can be used for WFS and WMS webrequests
web_request = WebRequest(geoservicesLibraryNetherlands.1_kadastrale_grenzen_WFS)
code_block_3 = CodeBlock { "gml:posList"; }
boolean = BoolSelector(false)
createPointsPolygonFromGMLxy = Custom[GIStoBIM.CreatePointsPolygonFromGMLxy](xml=web_request, xmltagname=code_block_3, deltaX=getLocationdataNetherlands.RDcoordinate_X_meters, deltaY=getLocationdataNetherlands.RDcoordinate_Y_meters, connectpolygon=boolean)  # Create point and polygons from a GML-file
