# Dynamo graph ExampleGML.dyn (Dynamo 1.3.1.1736)

file_path = Filename("GML_examples\bgt_wegdeel.gml")
string = StringInput(".//{http://www.opengis.net/gml}posList")
code_block = CodeBlock { "Dordrecht"; "Lange Geldersekade"; "1"; }
getLocationdataNetherlands = Custom[GIStoBIM.GetLocationdataNetherlands](city=code_block.out0, streetname=code_block.out1, housenumber=code_block.out2)  # Gives locationdata based on an adress in the Netherlands
code_block_2 = CodeBlock { 200; }
boolean = BoolSelector(false)
filterGML = Custom[GIStoBIM.FilterGML](gmlFile=file_path, xPATH=string, coordinateX=getLocationdataNetherlands.RDcoordinate_X_meters, coordinateY=getLocationdataNetherlands.RDcoordinate_Y_meters, boundingbox=code_block_2, connectpolycurves=boolean)  # filter GML-file based on boundingbox
setSharedCoordinate = Custom[GIStoBIM.SetSharedCoordinate](X=getLocationdataNetherlands.RDcoordinate_X_meters, Y=getLocationdataNetherlands.RDcoordinate_Y_meters)  # Set shared coordinate/project basepoint
