# Dynamo graph AHN3.dyn (Dynamo 1.3.3.4111)

code_block = CodeBlock { "boskoop"; "warmoeskade"; "2"; }
getLocationdataNetherlands = Custom[GIS2BIM.GetLocationdataNetherlands](City=code_block.out0, Streetname=code_block.out1, Housenumber=code_block.out2)  # Gives locationdata based on an adress in the Netherlands
code_block_2 = CodeBlock { 1000; }
createBoundingBox = Custom[GIS2BIM.CreateBoundingBox](CoordinateX=getLocationdataNetherlands.RDcoordinateX_meters_double, CoordinateY=getLocationdataNetherlands.RDcoordinateY_meters_double, BoxWidth=code_block_2, BoxHeight=code_block_2)  # create boundingboxstring for webrequests based on coördinates and dimensions
geoservicesLibraryNetherlands = Custom[GIS2BIM.GeoservicesLibraryNetherlands](BoundingBox=createBoundingBox.Boxstring)  # Library with multiple webadresses which can be used for WFS and WMS webrequests
downloadAHN = Custom[GIS2BIM.DownloadAHN](UrlwebrequestAHN2=geoservicesLibraryNetherlands.11_AHN2_webrequest_bladindex_OGC_WFS, UrlwebrequestAHN3=geoservicesLibraryNetherlands.AHN3_webrequest_bladindex_OGC_WFS)  # get the mapnumber(s) of the AHN based on a given boundingbox
openBrowser = Custom[GIS2BIM.OpenBrowser]()  # Opens a new window in your default browser with the given url.; unwired: url
web_request = WebRequest(getLocationdataNetherlands.URLWebrequest)
code_block_3 = CodeBlock(bbox=createBoundingBox.Boxstring) { bbox; }
getPointsFromBoxSelection = Custom[PointCloud.GetPointsFromBoxSelection]()  # WIP: collects the points from a point cloud instance by using a box shape collector (aka a Revit element such as a Mass). Mass geometry has to be a box (parallel faces). The number of points read must range from 1 to 1000000. Default 50000. Average Distance is a setting for PC density. Less distance increases the number of points.; unwired: Point_Cloud_Instance, Box
