# Dynamo graph AHN_CloudCompare.dyn (Dynamo 1.3.3.4111)

code_block = CodeBlock { "4326"; }
code_block_2 = CodeBlock { "28992"; }
code_block_3 = CodeBlock { "van der Takstraat"; "85"; "Rotterdam"; "The Netherlands"; }
geocodingNomatimAPI = Custom[GIS2BIM.GeocodingNomatimAPI](Streetname=code_block_3.out0, Housenumber=code_block_3.out1, Place=code_block_3.out2, Country=code_block_3.out3)  # gets WGS-84 coordinate from address with Open Streets Maps API
transformCRS_epsg = Custom[GIS2BIM.TransformCRS_epsg](sourceCRS=code_block, targetCRS=code_block_2, xCoordinate=geocodingNomatimAPI.longitude, yCoordinate=geocodingNomatimAPI.latitude)  # Uses the API of http://epsg.io to transform Coordinate Reference Systems

# group: INPUT
boundingbox = CodeBlock { 300; }
directory_laszip = CodeBlock { "C:/TEMP/TEMP"; }
filepath_laz_pointcloud = Filename("..\..\..\..\..\..\..\TEMP\TEMP\C_37HN1.LAZ")
new_filename = CodeBlock { "00_cropped.laz"; }

createBoundingBox = Custom[GIS2BIM.CreateBoundingBox](CoordinateX=transformCRS_epsg.Xtransformed, CoordinateY=transformCRS_epsg.Ytransformed, BoxWidth=boundingbox, BoxHeight=boundingbox)  # create boundingboxstring for webrequests based on coördinates and dimensions
geoservicesLibraryNetherlands = Custom[GIS2BIM.GeoservicesLibraryNetherlands](BoundingBox=createBoundingBox.Boxstring)  # Library with multiple webadresses which can be used for WFS and WMS webrequests
webrequestWMS2 = Custom[GIS2BIM.WebrequestWMS2](WMSwebrequest=geoservicesLibraryNetherlands.Luchtfoto_2017_OGC_WMS)  # a webrequest based on WMS-protocol
watch_image = WatchImageCore(webrequestWMS2)
searchCRS = Custom[GIS2BIM.SearchCRS](EPSG_Code=code_block)  # Search for a Coordinate Reference System
searchCRS_2 = Custom[GIS2BIM.SearchCRS](EPSG_Code=code_block_2)
downloadAHN = Custom[GIS2BIM.DownloadAHN](Urlwebrequest=geoservicesLibraryNetherlands.11_AHN2_webrequest_bladindex_OGC_WFS)  # get the mapnumber(s) of the AHN based on a given boundingbox
openBrowser = Custom[GIS2BIM.OpenBrowser](url=downloadAHN.Downloadlink_AHN2_uitgefilterd)  # frozen; Opens a new window in your default browser with the given url.

# group: CREATE BATCHFILE
code_block_4 = CodeBlock { "/"; "cropped6.bat"; }
concat = String.Concat(directory_laszip, code_block_4.out0, code_block_4.out1)
downloadLASZIP = Custom[GIS2BIM.DownloadLASZIP](Directory=directory_laszip)  # download and unzip laszip
code_block_5 = CodeBlock { " -i "; }
code_block_6 = CodeBlock { "-keep_classification 2 "; ""; " -oparse xyz"; }
string = StringInput("\"")
code_block_7 = CodeBlock { " -translate_x -"; " -translate_y -"; }
code_block_8 = CodeBlock(x=transformCRS_epsg.Xtransformed, y=transformCRS_epsg.Ytransformed, width=boundingbox) { x; y; width; }
toString = Custom[Springs.Number.ToString](num=code_block_8.x)  # Converts the input number(s) to string. You can optionally limit the number of digits.
toString_2 = Custom[Springs.Number.ToString](num=code_block_8.y)
code_block_9 = CodeBlock { " -inside "; " "; }
code_block_10 = CodeBlock(x=code_block_8.x, bbox=code_block_8.width, y=code_block_8.y) { x-0.5*bbox; x+0.5*bbox; y-0.5*bbox; y+0.5*bbox; }
toString_3 = Custom[Springs.Number.ToString](num=code_block_10.out0)
toString_4 = Custom[Springs.Number.ToString](num=code_block_10.out2)
toString_5 = Custom[Springs.Number.ToString](num=code_block_10.out1)
toString_6 = Custom[Springs.Number.ToString](num=code_block_10.out3)
code_block_11 = CodeBlock { " -odir "; " -o "; }
string_2 = StringInput("\"")
concat_2 = String.Concat(downloadLASZIP.Laszip, code_block_5, code_block_6.out1, string, filepath_laz_pointcloud, string, code_block_7.out0, toString, code_block_7.out1, toString_2, code_block_9.out0, toString_3, code_block_9.out1, toString_4, code_block_9.out1, toString_5, code_block_9.out1, toString_6, code_block_11.out0, string, directory_laszip, string, code_block_11.out1, string_2, new_filename, string_2)

writeToFile = CSV.WriteToFile(concat, concat_2)
openBrowser_2 = Custom[GIS2BIM.OpenBrowser](url=downloadAHN.downloadlink_AHN3)
sendTo = Custom[Clipboard.SendTo](str=downloadAHN.downloadlink_AHN3)  # Copies a string to the clipboard.
