# Dynamo graph AHN_CloudCompareImportMesh.dyn (Dynamo 1.3.2.2480)

file_path = Filename("..\..\..\..\..\..\..\TEMP\beach.obj")
importFile = Autodesk.Dynamo.MeshToolkit.Mesh.ImportFile(file_path)
code_block = CodeBlock { 50000; }
reduce = Autodesk.Dynamo.MeshToolkit.Mesh.Reduce(importFile, code_block)
code_block_2 = CodeBlock { 1000; }
scale = Autodesk.Dynamo.MeshToolkit.Mesh.Scale(reduce, code_block_2)
toolkitMeshToMesh = Custom[Springs.ToolkitMeshToMesh](tkMesh=scale)  # Attempts to convert a toolkit mesh to a Dynamo mesh. You obviously need to have the appropriate version of the mesh toolkit package downloaded first.
categories = Categories("GenericModel")
code_block_3 = CodeBlock { "000_MA_bestaande bebouwing_IP"; }
byName = Material.ByName(code_block_3)
byMesh = DirectShape.ByMesh(toolkitMeshToMesh, categories, byName)  # frozen
code_block_4 = CodeBlock { a=50000; b= Point.ByCoordinates(-a,a,-1000); c= Point.ByCoordinates(a,a,-1000); d= Point.ByCoordinates(-a,a,5000); }
byThreePoints = Plane.ByThreePoints(code_block_4.b, code_block_4.c, code_block_4.d)
intersect = Autodesk.Dynamo.MeshToolkit.Mesh.Intersect(scale, byThreePoints)
curves = PolyCurve.Curves(intersect)
flatten = Flatten(curves)
byCurve = ModelCurve.ByCurve(flatten)
