# Dynamo graph BGT New 3.dyn (Dynamo 2.10.1.3976)
# packages: GIS2BIM for Dynamo 2.x 0.11.19

string = StringInput("{\"featuretypes\":[\"waterdeel\"],\"format\":\"gmllight\",\"geofilter\":\"POLYGON((213089 593892, 217076 593892, 217076 597981, 213089 597981, 213089 593892))\"}")
code_block = CodeBlock { "C:/Users/mikev/AppData/Roaming/Dynamo/Dynamo Revit/2.10/packages/GIS2BIM for Dynamo 2.x/extra"; }
code_block_2 = CodeBlock()
# ---------- code_block_2.designscript (4 lines) ----------
"webserverRequests";
//Title
"BGTPOSTFullCustom";
"serverrequestprefix";
# ----------------------------------------
GIS2BIM_GetWebServerData = Custom[GIS2BIM_GetWebServerData](category=code_block_2.out0, title=code_block_2.out1, parameter=code_block_2.out2)  # package GIS2BIM for Dynamo 2.x; Get webserverdata from github repository of GIS2BIM(up to date list of GIS-servers & requests)
code_block_3 = CodeBlock { parameter: string = "serverrequestprefix"; }
code_block_4 = CodeBlock { category: string = "webserverRequests"; }
code_block_5 = CodeBlock { title: string = "BGTPOSTFullCustom"; }
string_2 = StringInput("{\"featuretypes\":[")
string_3 = StringInput("\"waterdeel\"")
string_4 = StringInput("],\"format\":\"gmllight\",\"geofilter\":\"POLYGON(")
code_block_6 = CodeBlock { "Dordrecht"; "werf van schouten"; "503"; }
GIS2BIM_GetLocationdataNetherlands = Custom[GIS2BIM_GetLocationdataNetherlands](City=code_block_6.out0, Streetname=code_block_6.out1, Housenumber=code_block_6.out2)  # package GIS2BIM for Dynamo 2.x; Gives locationdata based on an adress in the Netherlands
code_block_7 = CodeBlock { 1000; }
GIS2BIM_CreateBoundingBox = Custom[GIS2BIM_CreateBoundingBox](CoordinateX=GIS2BIM_GetLocationdataNetherlands.RDcoordinateXmeters, CoordinateY=GIS2BIM_GetLocationdataNetherlands.RDcoordinateYmeters, BoxWidth=code_block_7, BoxHeight=code_block_7)  # package GIS2BIM for Dynamo 2.x; create boundingboxstring for webrequests based on coördinates and dimensions
string_5 = StringInput(")\"}")
concat = String.Concat(string0=string_2, string1=string_3, string2=string_4, string3=GIS2BIM_CreateBoundingBox.PolygonString, string4=string_5)
code_block_8 = CodeBlock { "https://raw.githubusercontent.com/DutchSailor/GIS2BIM/master/GIS2BIM_Data.json"; }
python_script = Python(IN[0]=code_block_8, IN[1]=code_block_2.out0, IN[2]=code_block_2.out1, IN[3]=code_block_2.out2)  # CPython3
# ---------- python_script.python (18 lines) ----------
import sys
import json
import urllib

url = IN[0]
category = IN[1]
servertitle = IN[2]
parameter = IN[3]
req = urllib.request.urlopen(url)
req = req.read().decode('utf-8')
data = json.loads(req)['GIS2BIMserversRequests'][category]

test = []
for i in data:
	test.append(i["title"])
result = data[test.index(servertitle)][parameter]

OUT = result
# ----------------------------------------
python_script_2 = Python(IN[0]=concat, IN[1]=python_script)  # CPython3
# ---------- python_script_2.python (25 lines) ----------
import sys
import clr
import json
import urllib
import time

sys.path.append(r'C:\Users\mikev\AppData\Roaming\Python\Python37\site-packages')
import requests
from requests.structures import CaseInsensitiveDict

url = IN[1]

headers = CaseInsensitiveDict()
headers["accept"] = "application/json"
headers["Content-Type"] = "application/json"

data = IN[0] #Define format, polygon, layers

resp = requests.post(url, headers=headers, data=data)

jsondata = json.loads(resp.text)
data = jsondata["downloadRequestId"]
urlstatus = url + "/" + data + "/status" 

OUT = urlstatus
# ----------------------------------------
python_script_3 = Python(IN[0]=python_script_2, IN[1]=python_script)  # CPython3
# ---------- python_script_3.python (27 lines) ----------
import sys
import clr
import json
import urllib
import time

urlstatus = IN[0]
url= IN[1]

# Check URL Status
timeout = time.time() + 30

req = urllib.request.urlopen(urlstatus)
req2 = req.read().decode('utf-8')
progressStatus = float(json.loads(req2)['progress'])

progressStatus = 0
while progressStatus < 100:
    if progressStatus == 100 or time.time() > timeout:
        break
    time.sleep(1)
    
href = json.loads(req2)["_links"]["download"]["href"]

downloadURL = url + "/" + href

OUT = downloadURL
# ----------------------------------------
code_block_9 = CodeBlock { "C:/TEMP/"; }
python_script_4 = Python(IN[0]=python_script_3, IN[1]=code_block_9)  # IronPython2
# ---------- python_script_4.python (10 lines) ----------
import sys
sys.path.append("C:\Program Files (x86)\IronPython 2.7\Lib")
from System.Net import WebClient

url= IN[0]
filoc= IN[1]

WebClient().DownloadFile(url, filoc)

OUT= filoc
# ----------------------------------------
GIS2BIM_OpenBrowser = Custom[GIS2BIM_OpenBrowser](url=python_script_3)  # package GIS2BIM for Dynamo 2.x; Opens a new window in your default browser with the given url.
