# Dynamo graph BGT-Lines2.dyn (Dynamo 1.3.2.2480)

code_block = CodeBlock { 105600; 425000; }
getMortonCodeCoordinate = Custom[GIS2BIM.GetMortonCodeCoordinate](X=code_block.out0, Y=code_block.out1)  # Get mortoncode given 2 coordinates and tiledimension
TEMPfolder = StringInput("C:\TEMP")
code_block_2 = CodeBlock { 15892; }
downloadBGTdata = Custom[GIS2BIM.DownloadBGTdata](Mortoncode=code_block_2)  # Download BGT-data(dutch GIS-information); unwired: Directory
unzipFile = Custom[GIS2BIM.UnzipFile](FilePathZipFile=downloadBGTdata.Location, DirectoryToExtractTo=downloadBGTdata.Directory)  # Unzip zip-file

# group: 2D SETTINGS
# note: Panden;
# 0 bgt_overigbouwwerk;
# Groen;
# 1 bgt_begroeidterreindeel;
# Lijnen(aparte lagen);
# 2 bgt_functioneelgebied;
# 3 bgt_gebouwinstallatie;
# 4 bgt_kunstwerkdeel;
# 5 bgt_onbegroeidterreindeel;
# 6 bgt_ondersteunendwegdeel;
# 7 bgt_overigescheiding;
# 8 bgt_scheiding;
# 9 bgt_spoor;
# 10 bgt_tunneldeel;
# Wegen bruggen en kunstwerken;
# 11 bgt_kunstwerkdeel;
# 12 bgt_overbruggingsdeel;
# 13 bgt_wegdeel;
# Water;
# 14 bgt_ondersteunendwaterdeel;
# 15 bgt_waterdeel;
# Labels;
# 16 bgt_openbareruimtelabel;
# Puntobject;
# 17 bgt_vegetatieobject;
tree = FamilyTypes("90_DI_boom:90_DI_boom")
line_styles = CodeBlock()
# ---------- line_styles.designscript (9 lines) ----------
"bgt_functioneelgebied";
"bgt_gebouwinstallatie";
"bgt_kunstwerkdeel";
"bgt_onbegroeidterreindeel";
"bgt_ondersteunendwegdeel";
"bgt_overigescheiding";
"bgt_scheiding";
"bgt_spoor";
"bgt_tunneldeel";
# ----------------------------------------

code_block_3 = CodeBlock { Directory; }
code_block_4 = CodeBlock { FilledRegionGreen1; }  # unwired: FilledRegionGreen1
code_block_5 = CodeBlock { FilledRegionGreen2; }  # unwired: FilledRegionGreen2
code_block_6 = CodeBlock { LineStyleBGT_functioneelgebied; }  # unwired: LineStyleBGT_functioneelgebied
code_block_7 = CodeBlock { LineStyleBGT_gebouwinstallatie; }  # unwired: LineStyleBGT_gebouwinstallatie
code_block_8 = CodeBlock { LineStyleBGT_kunstwerkdeel; }  # unwired: LineStyleBGT_kunstwerkdeel
code_block_9 = CodeBlock { LineStyleBGT_onbegroeidterreindeel; }  # unwired: LineStyleBGT_onbegroeidterreindeel
code_block_10 = CodeBlock { LineStyleBGT_ondersteunendwegdeel; }  # unwired: LineStyleBGT_ondersteunendwegdeel
code_block_11 = CodeBlock { LineStyleBGT_overigescheiding; }  # unwired: LineStyleBGT_overigescheiding
code_block_12 = CodeBlock { LineStyleBGT_scheiding; }  # unwired: LineStyleBGT_scheiding
code_block_13 = CodeBlock { LineStyleBGT_spoor; }  # unwired: LineStyleBGT_spoor
code_block_14 = CodeBlock { LineStyleBGT_tunneldeel; }  # unwired: LineStyleBGT_tunneldeel
getSharedCoordinate = Custom[GIS2BIM.GetSharedCoordinate]()  # Get the current shared coordinate
code_block_15 = CodeBlock(RDx=getSharedCoordinate.RdxMeters) { RDx; }
code_block_16 = CodeBlock(RDy=getSharedCoordinate.RdyMeters) { RDy; }
width = CodeBlock { 150; }
code_block_17 = CodeBlock(BoundingboxWidth=width) { BoundingboxWidth; }

# group: PLACE TREES
code_block_18 = CodeBlock { 17; }
getItemAtIndex = List.GetItemAtIndex(index=code_block_18)  # unwired: list
string = StringInput(".//{http://www.opengis.net/gml}pos")
filterGML = Custom[GIS2BIM.FilterGML](GMLFile=getItemAtIndex, xPATH=string, CoordinateX=code_block_15, CoordinateY=code_block_16, Boundingbox=code_block_17)  # filter GML-file based on boundingbox
flatten = Flatten(filterGML.Points)

code_block_19 = CodeBlock { DetailcomponentTree; }  # unwired: DetailcomponentTree
code_block_20 = CodeBlock { View; }  # unwired: View

# group: clockwork familyinstance by point in view
code_block_21 = CodeBlock(item=flatten) { Flatten({item}); }
python_script = Python(IN[0]=code_block_21, IN[1]=code_block_19, IN[2]=code_block_20)
# ---------- python_script.python (31 lines) ----------
import clr
clr.AddReference('RevitAPI')
from Autodesk.Revit.DB import *

clr.AddReference("RevitNodes")
import Revit
clr.ImportExtensions(Revit.Elements)
clr.ImportExtensions(Revit.GeometryConversion)

clr.AddReference("RevitServices")
import RevitServices
from RevitServices.Persistence import DocumentManager
from RevitServices.Transactions import TransactionManager

doc = DocumentManager.Instance.CurrentDBDocument
points = UnwrapElement(IN[0])
famtype = UnwrapElement(IN[1])
lvl = UnwrapElement(IN[2])
elementlist = list()
counter = 0

TransactionManager.Instance.EnsureInTransaction(doc)
# make sure familysymbol is active
if famtype.IsActive == False:
	famtype.Activate()
	doc.Regenerate()
for point in points:
	newobj = doc.Create.NewFamilyInstance(point.ToXyz(),famtype,lvl)
	elementlist.append(newobj.ToDSType(False))
TransactionManager.Instance.TransactionTaskDone()
OUT = elementlist
# ----------------------------------------
python_script_2 = Python(IN[0]=flatten, IN[1]=python_script)
# ---------- python_script_2.python (4 lines) ----------
check = IN[0]
items = IN[1]
if isinstance(check, (list)): OUT = items
else: OUT = items[0]
# ----------------------------------------

code_block_22 = CodeBlock(x=python_script_2) { x; }
# note: It will take quite some time to run this node. It can take 10 minutes. When you run parts of it it will be quicker. Open the file: GIStoBIM1.rvt from the package-folder to use the standard filled regions and linetypes.
setSharedCoordinate = Custom[GIS2BIM.SetSharedCoordinate](X=code_block.out0, Y=code_block.out1)  # Set shared coordinate/project basepoint
code_block_23 = CodeBlock { "C:/TEMP/15892"; }

# group: GML INPUT
bgt_lagen = CodeBlock()
# ---------- bgt_lagen.designscript (19 lines) ----------
"bgt_overigbouwwerk.gml";
"bgt_begroeidterreindeel.gml";
"bgt_functioneelgebied.gml";
"bgt_gebouwinstallatie.gml";
"bgt_kunstwerkdeel.gml";
"bgt_onbegroeidterreindeel.gml";
"bgt_ondersteunendwegdeel.gml";
"bgt_overigescheiding.gml";
"bgt_scheiding.gml";
"bgt_spoor.gml";
"bgt_tunneldeel.gml";
"bgt_kunstwerkdeel.gml";
"bgt_overbruggingsdeel.gml";
"bgt_wegdeel.gml";
"bgt_ondersteunendwaterdeel.gml";
"bgt_waterdeel.gml";
"bgt_openbareruimtelabel.gml";
"bgt_vegetatieobject.gml";
"bgt_pand.gml";
# ----------------------------------------
create = List.Create(bgt_lagen.out0, bgt_lagen.out1, bgt_lagen.out2, bgt_lagen.out3, bgt_lagen.out4, bgt_lagen.out5, bgt_lagen.out6, bgt_lagen.out7, bgt_lagen.out8, bgt_lagen.out9, bgt_lagen.out10, bgt_lagen.out11, bgt_lagen.out12, bgt_lagen.out13, bgt_lagen.out14, bgt_lagen.out15, bgt_lagen.out16, bgt_lagen.out17, bgt_lagen.out18)
string_2 = StringInput("/")
concat = String.Concat(code_block_23, string_2)  # unwired: arg2
map = List.Map(list=create, f_x=concat)

# group: CREATE BOUNDINGBOX AND FILTER GML
string_3 = StringInput(".//{http://www.opengis.net/gml}posList")
filterGML_2 = Custom[GIS2BIM.FilterGML](xPATH=string_3, CoordinateX=code_block_15, CoordinateY=code_block_16, Boundingbox=code_block_17)  # unwired: GMLFile
map_2 = List.Map(list=map, f_x=filterGML_2.Polycurves)

flatten_2 = Flatten(map_2)
removeNulls = Lists.Manage.RemoveNulls(flatten_2)
explode = Geometry.Explode(removeNulls)
current = Document.Current()
activeView = Document.ActiveView(current)
code_block_24 = CodeBlock(View=activeView) { View; }

# group: CLOCKWORK DETAILLINE FROM CURVE
code_block_25 = CodeBlock(item=explode) { Flatten({item}); }
python_script_3 = Python(IN[0]=code_block_25, IN[1]=code_block_24)
# ---------- python_script_3.python (28 lines) ----------
import clr
clr.AddReference('RevitAPI')
from Autodesk.Revit.DB import *

clr.AddReference("RevitNodes")
import Revit
clr.ImportExtensions(Revit.GeometryConversion)

clr.AddReference("RevitServices")
import RevitServices
from RevitServices.Persistence import DocumentManager
from RevitServices.Transactions import TransactionManager

doc = DocumentManager.Instance.CurrentDBDocument
curves = UnwrapElement(IN[0])
view = UnwrapElement(IN[1])
elementlist = []

TransactionManager.Instance.EnsureInTransaction(doc)
if doc.IsFamilyDocument: 
	doc_create = doc.FamilyCreate
else: 
	doc_create = doc.Create
for curve in curves:
	detcurve = doc_create.NewDetailCurve(view, curve.ToRevitType())
	elementlist.append(detcurve)
TransactionManager.Instance.TransactionTaskDone()
OUT = elementlist
# ----------------------------------------
python_script_4 = Python(IN[0]=explode, IN[1]=python_script_3)  # same code as python_script_2

code_block_26 = CodeBlock { "Line Style"; }
element_types = ElementTypes("GraphicsStyle")
all_elements_of_type = ElementsOfType(element_types)
python_script_5 = Python(IN[0]=all_elements_of_type)
# ---------- python_script_5.python (21 lines) ----------
import clr
clr.AddReference('RevitAPI')
from Autodesk.Revit.DB import *

faminsts = IN[0]
elementlist = list()
for item in faminsts:
	try:
		n = UnwrapElement(item).Name
	except:
		# Use a built-in property of (wrapped) Dynamo elements for family symbols instead
		try:
			n = item.Name
		except:
			# maybe it's a parameter name
			try:
				n = item.Definition.Name
			except:
				n = []
	elementlist.append(n)
OUT = elementlist
# ----------------------------------------
count = List.Count()  # unwired: arg0
map_3 = List.Map(list=map_2, f_x=count)
code_block_27 = CodeBlock { "."; }
split = String.Split(create, code_block_27)
firstItem = List.FirstItem()  # unwired: arg0
map_4 = List.Map(list=split, f_x=firstItem)
python_script_6 = Python(IN[0]=map_3, IN[1]=map_4)
# ---------- python_script_6.python (22 lines) ----------
import clr
clr.AddReference('ProtoGeometry')
from Autodesk.DesignScript.Geometry import *
#The inputs to this node will be stored as a list in the IN variables.
dataEnteringNode = IN

a = IN[0]
b = IN[1]

d = []
for i in a:
    if i is None:
        d.append(0)
    else:
    	d.append(i)

c = []

for j,k in zip(d,b):
    c.append([k]*j)

OUT = c
# ----------------------------------------
code_block_28 = CodeBlock(Linestyle=python_script_6) { Linestyle; }
byKeysValues = Custom[Springs.Dictionary.ByKeysValues](keys=python_script_5, values=all_elements_of_type, searchKeys=code_block_28)  # Dictionaries are an incredibly powerful tool for making associative sets between two equal length lists. The first list must be of unique strings (or numbers) and will be the key and the second list will be the matching values (it can be made up of geometry, elements, even other lists) The search keys list will provide the corresponding value to the input key.
flatten_3 = Flatten(byKeysValues)
setParameterByName = Element.SetParameterByName(element=python_script_4, parameterName=code_block_26, value=flatten_3)
code_block_29 = CodeBlock(Detaillines=setParameterByName) { Detaillines; }
boolean = BoolSelector(true)
