# Dynamo graph sandboxTMS.dyn (Dynamo 1.3.1.1736)

code_block = CodeBlock { "zuidendijk"; "315"; "dordrecht"; "the netherlands"; }
geoCodingGoogleAPI = Custom[GIS2BIM.GeoCodingGoogleAPI](Streetname=code_block.out0, Housenumber=code_block.out1, Place=code_block.out2, Country=code_block.out3)  # gets coordinate from adress with google API
sendTo = Custom[Clipboard.SendTo]()  # Copies a string to the clipboard.; unwired: str
python_script = Python()  # unwired: IN[0]
# ---------- python_script.python (19 lines) ----------
import sys
sys.path.append("C:\Program Files (x86)\IronPython 2.7\Lib")

import clr

clr.AddReference("System.Drawing")
clr.AddReference("System")
from System.Drawing import Image
from System.Drawing import Bitmap
from System.Drawing import Graphics
from System.Drawing.Imaging import ImageFormat
from System.Net import WebRequest
url= IN[0]

request = WebRequest.Create(url)
response = request.GetResponse()
bitmap = Image.FromStream(response.GetResponseStream())

OUT = bitmap
# ----------------------------------------
webrequestWMS = Custom[GIS2BIM.WebrequestWMS]()  # imports the result(image) of a webrequest based on WMS-protocol into a view in Revit; unwired: WMSwebrequest, Boundingboxwidth, View, Filename
code_block_2 = CodeBlock { "C:/TEMP/test.jpg"; }
python_script_2 = Python(IN[1]=code_block_2)  # unwired: IN[0]
# ---------- python_script_2.python (11 lines) ----------
import sys
sys.path.append("C:\Program Files (x86)\IronPython 2.7\Lib")
from urllib import urlretrieve

url= IN[0]
tempfile= IN[1]


urlretrieve(url, tempfile)

OUT= tempfile
# ----------------------------------------
getLocationdataNetherlands = Custom[GIS2BIM.GetLocationdataNetherlands](City=code_block.out2, Streetname=code_block.out0, Housenumber=code_block.out1)  # Gives locationdata based on an adress in the Netherlands
desired_width = CodeBlock { 300; }
createBoundingBoxLATLONG = Custom[GIS2BIM.CreateBoundingBoxLATLONG](Lat=getLocationdataNetherlands.Latitude, Long=getLocationdataNetherlands.Longitude, WidthMeters=desired_width)  # create boundingbox with from lat/long coordinate in degrees
code_block_3 = CodeBlock { 19; }

# group: LEFT BOTTOM
TMSTileNumberFromCoordinate = Custom[GIS2BIM.TMSTileNumberFromCoordinate](Latitude=createBoundingBoxLATLONG.South, Longitude=createBoundingBoxLATLONG.West, Zoomlevel=code_block_3)  # Calculate TMS(Tile Map Service) Number from a lat/lon coördinate
TMSBoundingboxFromTileNumber = Custom[GIS2BIM.TMSBoundingboxFromTileNumber](TileX=TMSTileNumberFromCoordinate.dblXTile, TileY=TMSTileNumberFromCoordinate.dblYTile, Zoomlevel=code_block_3)  # Calculate Lat/Lon boundaries from a TileNumber in TMS(Tile Map Service)

TMSWebServices = Custom[GIS2BIM.TMSWebServices](TileX=TMSTileNumberFromCoordinate.strXTile, TileY=TMSTileNumberFromCoordinate.strYTile, Zoomlevel=code_block_3)  # Library With TMS Webservices
openBrowser = Custom[GIS2BIM.OpenBrowser]()  # Opens a new window in your default browser with the given url.; unwired: url

# group: TOP RIGHT
TMSTileNumberFromCoordinate_2 = Custom[GIS2BIM.TMSTileNumberFromCoordinate](Latitude=createBoundingBoxLATLONG.North, Longitude=createBoundingBoxLATLONG.East, Zoomlevel=code_block_3)
TMSBoundingboxFromTileNumber_2 = Custom[GIS2BIM.TMSBoundingboxFromTileNumber](TileX=TMSTileNumberFromCoordinate_2.dblXTile, TileY=TMSTileNumberFromCoordinate_2.dblYTile, Zoomlevel=code_block_3)

code_block_4 = CodeBlock(x2=TMSTileNumberFromCoordinate_2.dblXTile, x1=TMSTileNumberFromCoordinate.dblXTile, y2=TMSTileNumberFromCoordinate_2.dblYTile, y1=TMSTileNumberFromCoordinate.dblYTile) { deltax=x2-x1; deltay=y2-y1; }
