# Dynamo graph GIS2x_4.1 3D BAG V2.dyn (Dynamo 2.10.1.3976)
# packages: GIS2BIM for Dynamo 2.x 0.11.15, MeshToolkit 3.0.0, spring nodes 203.1.0

number = DoubleInput(500)  # graph input

# group: GET REVIT SITE LOCATION AND TRANSFORM TO RD-COORDINATES(EPSG 28992)
code_block = CodeBlock { "4326"; "28992"; }
GIS2BIM_GetRevitSiteLocation = Custom[GIS2BIM_GetRevitSiteLocation]()  # package GIS2BIM for Dynamo 2.x; Gets the properties of the current Site Location of the active Revit Project
toNumber = String.ToNumber(str=GIS2BIM_GetRevitSiteLocation.Lon)
toNumber_2 = String.ToNumber(str=GIS2BIM_GetRevitSiteLocation.Lat)
GIS2BIM_TransformCRS_epsg = Custom[GIS2BIM_TransformCRS_epsg](SourceCRS=code_block.out0, TargetCRS=code_block.out1, xCoordinate=toNumber, yCoordinate=toNumber_2)  # package GIS2BIM for Dynamo 2.x; Uses the API of http://epsg.io to transform Coordinate Reference Systems
GIS2BIM_CreateBoundingBox = Custom[GIS2BIM_CreateBoundingBox](CoordinateX=GIS2BIM_TransformCRS_epsg.Xtransformed, CoordinateY=GIS2BIM_TransformCRS_epsg.Ytransformed, BoxWidth=number, BoxHeight=number)  # package GIS2BIM for Dynamo 2.x; create boundingboxstring for webrequests based on coördinates and dimensions

# group: OTHER SERVERS
code_block_2 = CodeBlock { ".//{bag3d_v2}tile_id"; ".//{http://www.opengis.net/gml/3.2}posList"; ".//{bag3d_v2}bag_tiles_3k"; }
code_block_3 = CodeBlock { "https://data.3dbag.nl/obj/v21031_7425c21b/3dbag_v21031_7425c21b_"; "3432"; ".zip"; "/"; }

# group: DOWNLOAD LINKS
GIS2BIM_NetherlandsGeoservicesLibrary = Custom[GIS2BIM_NetherlandsGeoservicesLibrary](BoundingBoxEPSG28992=GIS2BIM_CreateBoundingBox.Boxstring)  # package GIS2BIM for Dynamo 2.x; Library with multiple webadresses which can be used for WFS and WMS webrequests
web_request = WebRequest(url=GIS2BIM_NetherlandsGeoservicesLibrary.BAG3D_V2_OGC_WFS)
watch = Watch(web_request)
list_create = List.Create(item0=code_block_2.out0, item1=code_block_2.out1, item2=code_block_2.out2)
GIS2BIM_XMLXPath = Custom[GIS2BIM_XMLXPath](XMLString=watch, XPathStrings=list_create)  # package GIS2BIM for Dynamo 2.x; Run an XPathquery on an xml-string
code_block_4 = CodeBlock(a=GIS2BIM_XMLXPath)
# ---------- code_block_4.designscript (2 lines) ----------
//list of tile-id's
a[0];
# ----------------------------------------

code_block_5 = CodeBlock { "C:/TEMP/"; }

# group: Download zip
concat = String.Concat(string0=code_block_3.out0, string2=code_block_3.out2)  # unwired: string1
map = List.Map(list=code_block_4, f_x=concat)
concat_2 = String.Concat(string0=code_block_5, string2=code_block_3.out2)  # unwired: string1
map_2 = List.Map(list=code_block_4, f_x=concat_2)
python_script = Python(IN[0]=map, IN[1]=map_2)  # IronPython2
# ---------- python_script.python (12 lines) ----------
import sys
sys.path.append("C:\Program Files (x86)\IronPython 2.7\Lib")
from System.Net import WebClient
import os

url= IN[0]
filoc= IN[1]

for i,j in zip(url,filoc):
	if not os.path.exists(j):
		WebClient().DownloadFile(i, j)
OUT= filoc
# ----------------------------------------

# group: Extract ZIP
code_block_6 = CodeBlock { ".zip"; "/"; }
replace = String.Replace(string=python_script, searchFor=code_block_6.out0, replaceWith=code_block_6.out1)
python_script_2 = Python(IN[0]=python_script, IN[1]=replace)  # IronPython2
# ---------- python_script_2.python (16 lines) ----------
import clr
clr.AddReference("System.IO.Compression.FileSystem")
from System.IO.Compression import ZipFile
import os

#The inputs to this node will be stored as a list in the IN variables.
dataEnteringNode = IN
tzip = IN[0]
tpath = IN[1]

for i,j in zip(tzip,tpath):
	if not os.path.exists(j):
		ZipFile.ExtractToDirectory(i, j)

#Assign your output to the OUT variable.
OUT = tpath
# ----------------------------------------

# group: combine filename .obj
code_block_7 = CodeBlock { ""; }
join = String.Join(separator=code_block_7)  # unwired: string0, string1
code_block_8 = CodeBlock { "3dbag_v21031_7425c21b_lod22_3d_"; "3432"; ".obj"; }
concat_3 = String.Concat(string0=code_block_8.out0, string2=code_block_8.out2)  # unwired: string1
map_3 = List.Map(list=code_block_4, f_x=concat_3)
combine = List.Combine(comb=join, list1=python_script_2, list2=map_3)

# group: Import Mesh Translate over Rdx/Rdy and scale to mm
importFile = Autodesk.Dynamo.MeshToolkit.Mesh.ImportFile(fileName=combine)
code_block_9 = CodeBlock(x=GIS2BIM_TransformCRS_epsg.Xtransformed, y=GIS2BIM_TransformCRS_epsg.Ytransformed) { x*-1; y*-1; }
translate = Autodesk.Dynamo.MeshToolkit.Mesh.Translate(mesh=importFile, x=code_block_9.out0, y=code_block_9.out1)
flatten = List.Flatten(list=translate)
code_block_10 = CodeBlock { 1000; }
scale = Autodesk.Dynamo.MeshToolkit.Mesh.Scale(mesh=flatten, scaleFactor=code_block_10)

code_block_11 = CodeBlock(B=number) { B; -0.5*B*1000; 0.5*B*1000; }
byCoordinates = Point.ByCoordinates(y=code_block_11.out1)
YAxis = Vector.YAxis()
byOriginNormal = Plane.ByOriginNormal(origin=byCoordinates, normal=YAxis)
planeCut = Autodesk.Dynamo.MeshToolkit.Mesh.PlaneCut(mesh=scale, plane=byOriginNormal)
byCoordinates_2 = Point.ByCoordinates(y=code_block_11.out2)
reverse = Vector.Reverse(vector=YAxis)
byOriginNormal_2 = Plane.ByOriginNormal(origin=byCoordinates_2, normal=reverse)
planeCut_2 = Autodesk.Dynamo.MeshToolkit.Mesh.PlaneCut(mesh=planeCut, plane=byOriginNormal_2)
byCoordinates_3 = Point.ByCoordinates(x=code_block_11.out1)
XAxis = Vector.XAxis()
byOriginNormal_3 = Plane.ByOriginNormal(origin=byCoordinates_3, normal=XAxis)
planeCut_3 = Autodesk.Dynamo.MeshToolkit.Mesh.PlaneCut(mesh=planeCut_2, plane=byOriginNormal_3)
byCoordinates_4 = Point.ByCoordinates(x=code_block_11.out2)
reverse_2 = Vector.Reverse(vector=XAxis)
byOriginNormal_4 = Plane.ByOriginNormal(origin=byCoordinates_4, normal=reverse_2)
planeCut_4 = Autodesk.Dynamo.MeshToolkit.Mesh.PlaneCut(mesh=planeCut_3, plane=byOriginNormal_4)
categories = Categories("OST_GenericModel")
code_block_12 = CodeBlock { "Default"; }
code_block_13 = CodeBlock { "NLRS_90_GM_3D_BAG"; }

# group: Place Mesh as DirectShape
ꟿ_tkmesh_tomesh = Custom[ꟿ TkMesh.ToMesh](tkMesh=planeCut_4)  # package spring nodes; Attempts to convert a toolkit mesh to a Dynamo mesh. You obviously need to have the appropriate version of the mesh toolkit package downloaded first.
byName = Material.ByName(name=code_block_12)
byMesh = DirectShape.ByMesh(mesh=ꟿ_tkmesh_tomesh, category=categories, material=byName, name=code_block_13)
