# Dynamo graph sandbox.dyn (Dynamo 1.3.1.1736)

code_block = CodeBlock()
# ---------- code_block.designscript (1 lines) ----------
http://services.rce.geovoorziening.nl/rce/wfs?&request=GetCapabilities&service=WFS
# ----------------------------------------
views = Views("Situation")
from_meters_to_millimeters = CodeBlock { 1000; }
code_block_2 = CodeBlock { "Dordrecht"; "Lange geldersekade"; "1"; }
getLocationdataNetherlands = Custom[GIStoBIM.GetLocationdataNetherlands](city=code_block_2.out0, streetname=code_block_2.out1, housenumber=code_block_2.out2)  # Gives locationdata based on an adress in the Netherlands
code_block_3 = CodeBlock { 300; }
createBoundingBox = Custom[GIStoBIM.CreateBoundingBox](coordinateX=getLocationdataNetherlands.RDcoordinate_X_meters, coordinateY=getLocationdataNetherlands.RDcoordinate_Y_meters, boxWidth=code_block_3, boxHeight=code_block_3)  # create boundingboxstring for webrequests based on coördinates and dimensions
geoservicesLibraryNetherlands = Custom[GIStoBIM.GeoservicesLibraryNetherlands](BoundingBox=createBoundingBox)  # Library with multiple webadresses which can be used for WFS and WMS webrequests
web_request = WebRequest(geoservicesLibraryNetherlands.7_kadastrale_annotatie)
code_block_4 = CodeBlock { "gml:pos"; }
getXMLNode = Lists.DataSets.GetXMLNode(web_request, code_block_4)
flatten = Flatten(getXMLNode)
code_block_5 = CodeBlock { " "; }
split = String.Split(flatten, code_block_5)
toNumber = String.ToNumber(split)
code_block_6 = CodeBlock { 1; 2; 0; }
rd_x = List.TakeEveryNthItem(arg1=code_block_6.out1, arg2=code_block_6.out0)  # unwired: arg0
map = List.Map(list=toNumber, f_x=rd_x)
mul = from_meters_to_millimeters * map
code_block_7 = CodeBlock(deltaX=getLocationdataNetherlands.RDcoordinate_X_meters)
# ---------- code_block_7.designscript (2 lines) ----------
//X-value of transformation of points and polygons
deltaX;
# ----------------------------------------
mul_2 = code_block_7 * from_meters_to_millimeters
x_convert_to_local_axis = mul - mul_2
rd_y = List.TakeEveryNthItem(arg1=code_block_6.out1, arg2=code_block_6.out2)  # unwired: arg0
map_2 = List.Map(list=toNumber, f_x=rd_y)
mul_3 = from_meters_to_millimeters * map_2
code_block_8 = CodeBlock(deltaY=getLocationdataNetherlands.RDcoordinate_Y_meters)
# ---------- code_block_8.designscript (2 lines) ----------
//Y-value of transformation of points and polygons
deltaY;
# ----------------------------------------
mul_4 = code_block_8 * from_meters_to_millimeters
y_convert_to_local_axis = mul_3 - mul_4
code_block_9 = CodeBlock { 0; }
byCoordinates = Point.ByCoordinates(x=x_convert_to_local_axis, y=y_convert_to_local_axis, z=code_block_9)
pruneDuplicates = Point.PruneDuplicates(points=byCoordinates)
flatten_2 = Flatten(pruneDuplicates)
string = StringInput("Z02")
code_block_10 = CodeBlock { "kadastralekaartv3:classificatiecode"; }
getXMLNode_2 = Lists.DataSets.GetXMLNode(web_request, code_block_10)
flatten_3 = Flatten(getXMLNode_2)
eq = string == flatten_3
filterByBoolMask = List.FilterByBoolMask(list=flatten_2, mask=eq)
flatten_4 = Flatten(filterByBoolMask.in)
code_block_11 = CodeBlock { "kadastralekaartv3:tekst"; }
getXMLNode_3 = Lists.DataSets.GetXMLNode(web_request, code_block_11)
flatten_5 = Flatten(getXMLNode_3)
filterByBoolMask_2 = List.FilterByBoolMask(list=flatten_5, mask=eq)
flatten_6 = Flatten(filterByBoolMask_2.in)
string_2 = StringInput("Center")
code_block_12 = CodeBlock { "kadastralekaartv3:rotatiehoek"; }
getXMLNode_4 = Lists.DataSets.GetXMLNode(web_request, code_block_12)
flatten_7 = Flatten(getXMLNode_4)
filterByBoolMask_3 = List.FilterByBoolMask(list=flatten_7, mask=eq)
flatten_8 = Flatten(filterByBoolMask_3.in)
toNumber_2 = String.ToNumber(flatten_8)
byLocation = TextNote.ByLocation(view=views, location=flatten_4, text=flatten_6, alignment=string_2, rotation=toNumber_2)
uniqueItems = List.UniqueItems(flatten_3)
sendTo = Custom[Clipboard.SendTo](str=web_request)  # Copies a string to the clipboard.
flatten_9 = Flatten(filterByBoolMask_3.out)
flatten_10 = Flatten(filterByBoolMask.out)
flatten_11 = Flatten(filterByBoolMask_2.out)
changeCase = String.ChangeCase()  # unwired: arg0, arg1
string_3 = StringInput("Center")
toNumber_3 = String.ToNumber(flatten_8)
byLocation_2 = TextNote.ByLocation(view=views, location=flatten_4, text=flatten_6, alignment=string_3, rotation=toNumber_3)
