# Dynamo graph sandboxGoogleAPI.dyn (Dynamo 1.3.1.1736)

code_block = CodeBlock { "george silundika street"; "10"; "bulawayo"; "zimbabwe"; }
geoCodingGoogleAPI = Custom[GIStoBIM.GeoCodingGoogleAPI](streetname=code_block.out0, housenumber=code_block.out1, place=code_block.out2, country=code_block.out3)  # gets coordinate from adress with google API
code_block_2 = CodeBlock { 2000; }
createBoundingBoxLATLONG = Custom[GIStoBIM.CreateBoundingBoxLATLONG](lat=geoCodingGoogleAPI.latitude, long=geoCodingGoogleAPI.longitude, width_meters=code_block_2)  # create boundingbox with from lat/long coordinate in degrees
code_block_3 = CodeBlock { "C:/TEMP"; }
downloadOSM = Custom[GIStoBIM.DownloadOSM](West=createBoundingBoxLATLONG.West, East=createBoundingBoxLATLONG.East, North=createBoundingBoxLATLONG.North, South=createBoundingBoxLATLONG.South, directory=code_block_3)  # Download OSM data within a boundingbox
location = Elk.OSM.Location(downloadOSM.Location)
features = Elk.OSM.Features()
code_block_4 = CodeBlock { 5; }
getItemAtIndex = List.GetItemAtIndex(list=features, index=code_block_4)
OSMData = Elk.OSM.OSMData(location.out0, location.out1, getItemAtIndex)  # unwired: arg3
code_block_5 = CodeBlock { 0; }
subFeatures = Elk.OSM.SubFeatures(getItemAtIndex, code_block_5)
